% Simulink data dictionary ConfigData.sldd

SoundSpeed = 300
CanaryCarrierFrequency = 20000
CanaryDataRate = 100
PreConvolveDownsample = 32
WalshCodeIndex = [3 9]
SampleRate = 48000
FmFrequencyDifferential = 400
FmDecoderFrameSize = 128
WalshCodeLength = 16

WalshCodeCache = [-1 -1
 1 1
 1 1
 1 1
 1 1
 1 1
 1 1
 1 1
 1 1
 1 1
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 ]

ModulatedCanaryCachedCycle = [-0.1164088 -0.1160444
 -0.01551042 -0.05413179
 0.133722 0.1940663
 -0.2079405 -0.2613555
 0.2197328 0.2381616
 -0.166182 -0.1353933
 0.06189871 -0.009850799
 0.06653429 0.1479227
 -0.1860301 -0.2319317
 0.2669825 0.2345085
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 ]

UnModulatedCanaryCachedCycle = [397.6637 -386.7825
 397.6603 -386.4157
 397.6567 -386.0534
 397.653 -385.6958
 397.6491 -385.343
 397.6451 -384.9952
 397.6409 -384.6526
 397.6366 -384.3154
 397.6321 -383.9838
 397.6275 -383.6579
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 ]

FmFrequencyDataCache = [-2.843304e-12 -8.526758e-12
 0.544639 0.4539905
 -0.9135455 -0.809017
 0.9876883 0.9876883
 -0.7431448 -0.9510565
 0.258819 0.7071068
 0.309017 -0.309017
 -0.777146 -0.1564345
 0.9945219 0.5877853
 -0.8910065 -0.8910065
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 ]

DataAmplitude = 0.5
CanaryAmplitude = 0.25